# Grasshopper definition json-to-viewer.gh (Grasshopper 1.0.7)
# plug-ins: ShapeDiverForGrasshopper

mplane = MeshPlane(Boundary={Plane=PlaneXY(0, 0, 0), Size=Domain2(u=-10..10, v=-10..10)}, WidthCount=5, HeightCount=5)  # -> Mesh, Area
demesh = DeconstructMesh(Mesh=mplane.Mesh)  # -> Vertices, Faces, Colours, Normals
panel = Panel(demesh.Colours)
panel_2 = Panel(demesh.Faces)
panel_3 = Panel(demesh.Vertices)
panel_4 = Panel(demesh.Normals)
constructjson = ConstructJSON(Data=panel_3, AddressString="vertices")
constructjson_2 = ConstructJSON(Object=constructjson, Data=panel_2, AddressString="faces")
constructjson_3 = ConstructJSON(Object=constructjson_2, Data=panel, AddressString="color")
# JSON Output
panel_5 = Panel(constructjson_3)
panel_6 = Panel("https://raw.githubusercontent.com/Kyungho0511/3d-scan-with-spatial-analysis/refs/heads/simulation-to-viewer/ViewerData/sun_analysis.txt")
# Local file //
# Online raw data link
path = FilePath("C:\Users\kewei\Documents\GitHub\3d-scan-with-spatial-analysis\JsonTest\sun_analysis.txt")
importtxt = ImportText(
    URI=panel_6,
    maximum_file_size=52428800,
    selected_file_formats="application/json,application/xml,application/x-step,text/csv,text/plain")
sdjsonparse = ShapeDiverJSONParse(JSON=importtxt)
data = Data(sdjsonparse)

# ----
# Faces
panel_7 = Panel("faces")
accessjson = AccessJSON(Object=data, AddressString=panel_7)
convertjson = ConvertJSON(Object=accessjson)

# ----
# Color
panel_8 = Panel("color")
accessjson_2 = AccessJSON(Object=data, AddressString=panel_8)
convertjson_2 = ConvertJSON(Object=accessjson_2)
# add more options for switch
# inbetween different visualization types
txt = Text(convertjson_2)

# ----
# JSON Input
panel_9 = Panel("vertices")
accessjson_3 = AccessJSON(Object=data, AddressString=panel_9)
convertjson_3 = ConvertJSON(Object=accessjson_3)

txt_2 = Text(convertjson_3)
txt_3 = Text(convertjson)
color_filter = StreamFilter(Gate=0, Stream0=txt, Stream1="255,255,255")
gltf2material = GlTF20Material(
    BaseColorFactor=color_filter,
    MetallicFactor=0,
    RoughnessFactor=0.75,
    EmissiveFactor=RGB(0, 0, 0),
    AlphaMode="OPAQUE",
    AlphaCutoff=0.5,
    DoubleSided=True)
conmesh = ConstructMesh(Vertices=txt_2, Faces=txt_3, Colours=color_filter)  # -> graft(Mesh)
gltfdisplay = GlTF20Display(Geometry=conmesh, Material=gltf2material)
